% Simulink data dictionary MotorControlDataDictionary_Math.sldd

MC_CtrlPara_10 = Simulink.Parameter(1, StorageClass="Const", DataType="single", Min=0, Max=1)  % 电机控制参数10
MC_CtrlPara_11 = Simulink.Parameter(1, StorageClass="Const", DataType="single", Min=0, Max=1)  % 电机控制参数11
MC_CtrlPara_12 = Simulink.Parameter(1, StorageClass="Const", DataType="single", Min=0, Max=1)  % 电机控制参数12
MC_CtrlPara_13 = Simulink.Parameter(1, StorageClass="Const", DataType="single", Min=0, Max=1)  % 电机控制参数13
MC_CtrlPara_14 = Simulink.Parameter(1, StorageClass="Const", DataType="single", Min=0, Max=1)  % 电机控制参数14
MC_CtrlPara_15 = Simulink.Parameter(1, StorageClass="Const", DataType="single", Min=0, Max=1)  % 电机控制参数15
MC_CtrlPara_16 = Simulink.Parameter(1, StorageClass="Const", DataType="single", Min=0, Max=1)  % 电机控制参数16
MC_CtrlPara_17 = Simulink.Parameter(1, StorageClass="Const", DataType="single", Min=0, Max=1)  % 电机控制参数17
MC_CtrlPara_18 = Simulink.Parameter(1, StorageClass="Const", DataType="single", Min=0, Max=1)  % 电机控制参数18
MC_CtrlPara_19 = Simulink.Parameter(1, StorageClass="Const", DataType="single", Min=0, Max=1)  % 电机控制参数19
MC_CtrlPara_20 = Simulink.Parameter(1, StorageClass="Const", DataType="single", Min=0, Max=1)  % 电机控制参数20
MC_CtrlPara_21 = Simulink.Parameter(1, StorageClass="Const", DataType="single", Min=0, Max=1)  % 电机控制参数21
MC_CtrlPara_22 = Simulink.Parameter(1, StorageClass="Const", DataType="single", Min=0, Max=1)  % 电机控制参数22
MC_CtrlPara_23 = Simulink.Parameter(1, StorageClass="Const", DataType="single", Min=0, Max=1)  % 电机控制参数23
MC_CtrlPara_24 = Simulink.Parameter(1, StorageClass="Const", DataType="single", Min=0, Max=1)  % 电机控制参数24
MC_CtrlPara_25 = Simulink.Parameter(1, StorageClass="Const", DataType="single", Min=0, Max=1)  % 电机控制参数25
MC_CtrlPara_26 = Simulink.Parameter(1, StorageClass="Const", DataType="single", Min=0, Max=1)  % 电机控制参数26
MC_CtrlPara_27 = Simulink.Parameter(1, StorageClass="Const", DataType="single", Min=0, Max=1)  % 电机控制参数27
MC_CtrlPara_28 = Simulink.Parameter(1, StorageClass="Const", DataType="single", Min=0, Max=1)  % 电机控制参数28
MC_CtrlPara_29 = Simulink.Parameter(1, StorageClass="Const", DataType="single", Min=0, Max=1)  % 电机控制参数29
MC_CtrlPara_3 = Simulink.Parameter(1, StorageClass="Const", DataType="single", Min=0, Max=1)  % 电机控制参数3
MC_CtrlPara_30 = Simulink.Parameter(1, StorageClass="Const", DataType="single", Min=0, Max=1)  % 电机控制参数30
MC_CtrlPara_31 = Simulink.Parameter(1, StorageClass="Const", DataType="single", Min=0, Max=1)  % 电机控制参数31
MC_CtrlPara_32 = Simulink.Parameter(1, StorageClass="Const", DataType="single", Min=0, Max=1)  % 电机控制参数32
MC_CtrlPara_33 = Simulink.Parameter(1, StorageClass="Const", DataType="single", Min=0, Max=1)  % 电机控制参数33
MC_CtrlPara_34 = Simulink.Parameter(1, StorageClass="Const", DataType="single", Min=0, Max=1)  % 电机控制参数34
MC_CtrlPara_35 = Simulink.Parameter(1, StorageClass="Const", DataType="single", Min=0, Max=1)  % 电机控制参数35
MC_CtrlPara_36 = Simulink.Parameter(1, StorageClass="Const", DataType="single", Min=0, Max=1)  % 电机控制参数36
MC_CtrlPara_37 = Simulink.Parameter(1, StorageClass="Const", DataType="single", Min=0, Max=1)  % 电机控制参数37
MC_CtrlPara_38 = Simulink.Parameter(1, StorageClass="Const", DataType="single", Min=0, Max=1)  % 电机控制参数38
MC_CtrlPara_39 = Simulink.Parameter(1, StorageClass="Const", DataType="single", Min=0, Max=1)  % 电机控制参数39
MC_CtrlPara_4 = Simulink.Parameter(1, StorageClass="Const", DataType="single", Min=0, Max=1)  % 电机控制参数4
MC_CtrlPara_40 = Simulink.Parameter(1, StorageClass="Const", DataType="single", Min=0, Max=1)  % 电机控制参数40
MC_CtrlPara_41 = Simulink.Parameter(1, StorageClass="Const", DataType="single", Min=0, Max=1)  % 电机控制参数41
MC_CtrlPara_5 = Simulink.Parameter(1, StorageClass="Const", DataType="single", Min=0, Max=1)  % 电机控制参数5
MC_CtrlPara_6 = Simulink.Parameter(1, StorageClass="Const", DataType="single", Min=0, Max=1)  % 电机控制参数6
MC_CtrlPara_7 = Simulink.Parameter(1, StorageClass="Const", DataType="single", Min=0, Max=1)  % 电机控制参数7
MC_CtrlPara_8 = Simulink.Parameter(1, StorageClass="Const", DataType="single", Min=0, Max=1)  % 电机控制参数8
MC_CtrlPara_9 = Simulink.Parameter(1, StorageClass="Const", DataType="single", Min=0, Max=1)  % 电机控制参数9
MC_CtrlPara_BusCurrentRC_Gain = Simulink.Parameter(1, StorageClass="Const", DataType="single", Min=0, Max=1)  % 电机控制参数2
MC_CtrlPara_CurrentLoop_UdMax = Simulink.Parameter(50, StorageClass="Const", DataType="single", Min=0, Max=59.87642)  % 电机D轴电流环PI控制器Ud最大值
MC_CtrlPara_CurrentLoop_UdMin = Simulink.Parameter(-50, StorageClass="Const", DataType="single", Min=-59.87642, Max=0)  % 电机D轴电流环PI控制器Ud最小值
MC_CtrlPara_CurrentLoop_UqMax = Simulink.Parameter(100, StorageClass="Const", DataType="single", Min=0, Max=179.6292)  % 电机Q轴电流环PI控制器Uq最大值
MC_CtrlPara_CurrentLoop_UqMin = Simulink.Parameter(-100, StorageClass="Const", DataType="single", Min=-179.6292, Max=0)  % 电机Q轴电流环PI控制器Uq最小值
MC_CtrlPara_CurrentPI_AntiWindingD = Simulink.Parameter(1, StorageClass="Const", DataType="single", Min=0, Max=10)  % 电机D轴电流环PI控制器积分分离阈值
MC_CtrlPara_CurrentPI_AntiWindingQ = Simulink.Parameter(1, StorageClass="Const", DataType="single", Min=0, Max=10)  % 电机Q轴电流环Pi控制器积分分离阈值
MC_CtrlPara_CurrentPI_KiD = Simulink.Parameter(0.0366565, StorageClass="Const", DataType="single", Min=0, Max=1)  % 电机D轴电流环PI控制器Ki值
MC_CtrlPara_CurrentPI_KiQ = Simulink.Parameter(0.0366565, StorageClass="Const", DataType="single", Min=0, Max=1)  % 电机Q轴电流环Pi控制器Ki值
MC_CtrlPara_CurrentPI_KpD = Simulink.Parameter(0.3455752, StorageClass="Const", DataType="single", Min=0, Max=1)  % 电机D轴电流环PI控制器Kp值
MC_CtrlPara_CurrentPI_KpQ = Simulink.Parameter(0.3455752, StorageClass="Const", DataType="single", Min=0, Max=1)  % 电机Q轴电流环PI控制器Kp值
MC_CtrlPara_PhaseCurrentRC_Gain = Simulink.Parameter(1, StorageClass="Const", DataType="single", Min=0, Max=1)  % 电机控制参数1
MC_CtrlPara_PositionP_Kp = Simulink.Parameter(1, StorageClass="Const", DataType="single", Min=0, Max=1)  % 电机位置环PI控制器Kp值
MC_CtrlPara_SpeedPI_Ki = Simulink.Parameter(1, StorageClass="Const", DataType="single", Min=0, Max=1)  % 电机转速环PI控制器Ki值
MC_CtrlPara_SpeedPI_Kp = Simulink.Parameter(1, StorageClass="Const", DataType="single", Min=0, Max=1)  % 电机转速环PI控制器Kp值
MC_CtrlPara_TorquePI_Ki = Simulink.Parameter(1, StorageClass="Const", DataType="single", Min=0, Max=1)  % 电机转矩环PI控制器Ki值
MC_CtrlPara_TorquePI_Kp = Simulink.Parameter(1, StorageClass="Const", DataType="single", Min=0, Max=1)  % 电机转矩环PI控制器Kp值
MC_Hardawre_Chip_PreDrive = Simulink.Parameter(0, StorageClass="Const", DataType="double", Min=0, Max=1)  % 硬件预驱类型
MC_Hardawre_Chip_Type = Simulink.Parameter(0, StorageClass="Const", DataType="double", Min=0, Max=1)  % 硬件MCU类型
MC_Hardware_Chip_ADCClock = Simulink.Parameter(40000000, StorageClass="Const", DataType="double", Min=0, Max=1)  % 硬件ADC时钟
MC_Hardware_Chip_ADCKeepPeriod = Simulink.Parameter(1, StorageClass="Const", DataType="double", Min=0, Max=128)  % 硬件ADC采样保持周期
MC_Hardware_Chip_ADCResultBit = Simulink.Parameter(12, StorageClass="Const", DataType="double", Min=0, Max=16)  % 硬件ADC位数
MC_Hardware_Chip_ADCSamplePeriod = Simulink.Parameter(1, StorageClass="Const", DataType="double", Min=0, Max=128)  % 硬件ADC采样周期
MC_Hardware_Chip_ADCTransPeriod = Simulink.Parameter(1, StorageClass="Const", DataType="double", Min=0, Max=128)  % 硬件ADC转换周期
MC_Hardware_Chip_ADCVoltageOffset = Simulink.Parameter(0, StorageClass="Const", DataType="double", Min=0, Max=1)  % 硬件ADC参考电压
MC_Hardware_Chip_ADCVoltageRefence = Simulink.Parameter(1, StorageClass="Const", DataType="double", Min=0, Max=100)  % 硬件ADC最大电压
MC_Hardware_Chip_CSAGain = Simulink.Parameter(1, StorageClass="Const", DataType="double", Min=0, Max=1)  % 硬件CSA增益
MC_Hardware_Chip_Clock = Simulink.Parameter(40000000, StorageClass="Const", DataType="double", Min=0, Max=1)  % 硬件MCU主时钟
MC_Hardware_Chip_PWMPeriod = Simulink.Parameter(15000, StorageClass="Const", DataType="double", Min=0, Max=1)  % 硬件PWM周期
MC_Hardware_Diode_Lon = Simulink.Parameter(0, StorageClass="Const", DataType="double", Min=0, Max=1)  % 硬件整流二极管电感
MC_Hardware_Diode_Rds = Simulink.Parameter(0.001, StorageClass="Const", DataType="double", Min=0, Max=1)  % 硬件整流二极管内阻
MC_Hardware_Diode_SC = Simulink.Parameter(2.5e-9, StorageClass="Const", DataType="double", Min=0, Max=1)  % 硬件整流二极管并联电容
MC_Hardware_Diode_SR = Simulink.Parameter(500, StorageClass="Const", DataType="double", Min=0, Max=1000)  % 硬件整流二极管并联电阻
MC_Hardware_Diode_Vf = Simulink.Parameter(0.8, StorageClass="Const", DataType="double", Min=0, Max=1)  % 硬件整流二极管导通电压
MC_Hardware_IGBT_DeadTime = Simulink.Parameter(1.3e-6, StorageClass="Const", DataType="double", Min=0, Max=1)  % 硬件IGBT死区时间
MC_Hardware_IGBT_Lon = Simulink.Parameter(0, StorageClass="Const", DataType="double", Min=0, Max=1)  % 硬件IGBT管电感
MC_Hardware_IGBT_Rds = Simulink.Parameter(0.001, StorageClass="Const", DataType="double", Min=0, Max=1)  % 硬件IGBT管内阻
MC_Hardware_IGBT_SC = Simulink.Parameter(2.5e-9, StorageClass="Const", DataType="double", Min=0, Max=1)  % 硬件IGBT并联电容
MC_Hardware_IGBT_SR = Simulink.Parameter(500, StorageClass="Const", DataType="double", Min=0, Max=1000)  % 硬件IGBT并联电阻
MC_Hardware_IGBT_Vf = Simulink.Parameter(0.8, StorageClass="Const", DataType="double", Min=0, Max=1)  % 硬件IGBT导通电压
MC_Hardware_Input_IbusMax = Simulink.Parameter(100, StorageClass="Const", DataType="double", Min=0, Max=200)  % 母线电流最大值
MC_Hardware_Input_Vac = Simulink.Parameter(311.127, StorageClass="Const", DataType="double", Min=0, Max=1000)  % 硬件额定电压
MC_Hardware_Input_VbusMax = Simulink.Parameter(311.127, StorageClass="Const", DataType="double", Min=0, Max=311.127)  % 硬件最大电压
MC_Hardware_Input_VbusMin = Simulink.Parameter(0, StorageClass="Const", DataType="double", Min=0, Max=311.127)  % 硬件最小电压

MC_Hardware_Sample_CurrentType = Simulink.Parameter(1, StorageClass="Const", DataType="double", Min=0, Max=3)  % 硬件相电流采样类型：
  % 0无电阻采样；
  % 1单电阻采样；
  % 2双电阻采样；
  % 3三电阻采样；

MC_Hardware_Sample_IPhaseSamplePeriod = Simulink.Parameter(0, StorageClass="Const", DataType="double", Min=0, Max=1)  % 硬件相电流采样周期
MC_Hardware_Sample_Resistor = Simulink.Parameter(0.001, StorageClass="Const", DataType="double", Min=0, Max=1)  % 硬件相电流采样电阻
MC_Hardware_Sample_VPhaseSamplePeriod = Simulink.Parameter(0, StorageClass="Const", DataType="double", Min=0, Max=1)  % 硬件相电压采样周期
MC_Hardware_Sample_VbusSamplePeriod = Simulink.Parameter(0, StorageClass="Const", DataType="double", Min=0, Max=1)  % 硬件直流母线电压采样周期
MC_Hardware_Sample_VbusSampleResistor = Simulink.Parameter(0.001, StorageClass="Const", DataType="double", Min=0, Max=1)  % 硬件直流母线电压采样电阻
MC_Hardware_Senseor_AngleSamplePeriod = Simulink.Parameter(2000, StorageClass="Const", DataType="double", Min=0, Max=1)  % 硬件位置传感器采样周期

MC_Hardware_Senseor_AngleType = Simulink.Parameter(1, StorageClass="Const", DataType="double", Min=0, Max=4)  % 硬件位置传感器类型：
  % 0 无传感器；
  % 1 角度传感器；

MC_Hardware_Senseor_TorqueSamplePeriod = Simulink.Parameter(0, StorageClass="Const", DataType="double", Min=0, Max=1)  % 硬件扭矩传感器采样周期
MC_Hardware_Senseor_TorqueType = Simulink.Parameter(0, StorageClass="Const", DataType="double", Min=0, Max=1)  % 硬件扭矩传感器类型
MC_MotorModel_Const_Ke = Simulink.Parameter(1.209095, StorageClass="Const", DataType="double", Min=0, Max=1)  % 电机本体反电势系数
MC_MotorModel_Const_Psi = Simulink.Parameter(0.003333333, StorageClass="Const", DataType="double", Min=0, Max=1)  % 电机本体转子磁链
MC_MotorModel_Const_Torque = Simulink.Parameter(0.01, StorageClass="Const", DataType="double", Min=0, Max=100)  % 电机转矩常数
MC_MotorModel_Mechinal_Damp = Simulink.Parameter(1.0e-6, StorageClass="Const", DataType="double", Min=0, Max=1)  % 电机本体转动阻尼
MC_MotorModel_Mechinal_Inertia = Simulink.Parameter(1.4e-6, StorageClass="Const", DataType="double", Min=0, Max=1)  % 电机本体转动惯量
MC_MotorModel_Mechinal_TfCoff = Simulink.Parameter(1.0e-6, StorageClass="Const", DataType="double", Min=0, Max=1)  % 电机机械动阻力系数
MC_MotorModel_Mechinal_Tfric = Simulink.Parameter(1.0e-6, StorageClass="Const", DataType="double", Min=0, Max=1)  % 电机本体静摩擦力矩

MC_MotorModel_ModelType = Simulink.Parameter(0, StorageClass="Const", DataType="double", Min=0, Max=1)  % 电机模型类型
  % （注）

MC_MotorModel_PowerMax = Simulink.Parameter(0, StorageClass="Const", DataType="double", Min=0, Max=1)  % 电机输入最大功率
MC_MotorModel_Rotor_Pn = Simulink.Parameter(2, StorageClass="Const", DataType="double", Min=0, Max=48)  % 电机极对数
MC_MotorModel_SpeedBase = Simulink.Parameter(16200, StorageClass="Const", DataType="double", Min=0, Max=1)  % 电机机械额定转速
MC_MotorModel_SpeedMax = Simulink.Parameter(0, StorageClass="Const", DataType="double", Min=0, Max=1)  % 电机机械最大转速
MC_MotorModel_Stator_L0 = Simulink.Parameter(0, StorageClass="Const", DataType="double", Min=0, Max=1)  % 电机定子零序电感
MC_MotorModel_Stator_La = Simulink.Parameter(5.5e-5, StorageClass="Const", DataType="double", Min=0, Max=1)  % 电机定子A相电感
MC_MotorModel_Stator_Lab = Simulink.Parameter(0, StorageClass="Const", DataType="double", Min=0, Max=1)  % 电机定子Alpha/Beta互电感
MC_MotorModel_Stator_Lalpha = Simulink.Parameter(5.5e-5, StorageClass="Const", DataType="double", Min=0, Max=1)  % 电机定子Alpha轴电感
MC_MotorModel_Stator_Lb = Simulink.Parameter(5.5e-5, StorageClass="Const", DataType="double", Min=0, Max=1)  % 电机定子B相电感
MC_MotorModel_Stator_Lbeta = Simulink.Parameter(5.5e-5, StorageClass="Const", DataType="double", Min=0, Max=1)  % 电机定子Beta轴电感
MC_MotorModel_Stator_Lc = Simulink.Parameter(5.5e-5, StorageClass="Const", DataType="double", Min=0, Max=1)  % 电机定子C相电感
MC_MotorModel_Stator_Ld = Simulink.Parameter(5.5e-5, StorageClass="Const", DataType="double", Min=0, Max=1)  % 电机定子D轴电感
MC_MotorModel_Stator_Lline = Simulink.Parameter(0.00011, StorageClass="Const", DataType="double", Min=0, Max=1)  % 电机定子线电感
MC_MotorModel_Stator_Lq = Simulink.Parameter(5.5e-5, StorageClass="Const", DataType="double", Min=0, Max=1)  % 电机定子Q轴电感
MC_MotorModel_Stator_Ls = Simulink.Parameter(5.5e-5, StorageClass="Const", DataType="double", Min=0, Max=1)  % 电机定子均值电感
MC_MotorModel_Stator_Ra = Simulink.Parameter(0.0875, StorageClass="Const", DataType="double", Min=0, Max=1)  % 电机定子A相电阻
MC_MotorModel_Stator_Ralpha = Simulink.Parameter(0.0875, StorageClass="Const", DataType="double", Min=0, Max=1)  % 电机定子Alpha轴电阻
MC_MotorModel_Stator_Rb = Simulink.Parameter(0.0875, StorageClass="Const", DataType="double", Min=0, Max=1)  % 电机定子B相电阻
MC_MotorModel_Stator_Rbeta = Simulink.Parameter(0.0875, StorageClass="Const", DataType="double", Min=0, Max=1)  % 电机定子Beta轴电阻
MC_MotorModel_Stator_Rc = Simulink.Parameter(0.0875, StorageClass="Const", DataType="double", Min=0, Max=1)  % 电机定子C相电阻
MC_MotorModel_Stator_Rd = Simulink.Parameter(0.0875, StorageClass="Const", DataType="double", Min=0, Max=1)  % 电机定子D轴电阻
MC_MotorModel_Stator_Rline = Simulink.Parameter(0.175, StorageClass="Const", DataType="double", Min=0, Max=1)  % 电机定子线电阻
MC_MotorModel_Stator_Rq = Simulink.Parameter(0.0875, StorageClass="Const", DataType="double", Min=0, Max=1)  % 电机定子Q轴电阻
MC_MotorModel_Stator_Rs = Simulink.Parameter(0.0875, StorageClass="Const", DataType="double", Min=0, Max=1)  % 电机定子均值相电阻

MC_MotorModel_WindingType = Simulink.Parameter(1, StorageClass="Const", DataType="double", Min=1, Max=2)  % 电机绕组类型：
  % 1：星型绕组；
  % 2：三角绕组；

MC_Sim_BaseFreq = Simulink.Parameter(40000000, StorageClass="Const", DataType="double", Min=0, Max=1000000000)  % 基础时钟频率
MC_Sim_BaseStep = Simulink.Parameter(2.5e-8, StorageClass="Const", DataType="double", Min=0, Max=6.6675e-07)  % 基础任务步长
MC_Sim_HFTFreq = Simulink.Parameter(15000, StorageClass="Const", DataType="double", Min=0, Max=400000)  % 高频任务频率
MC_Sim_HFTStep = Simulink.Parameter(6.6675e-5, StorageClass="Const", DataType="double", Min=0, Max=0.000200025)  % 高频任务步长
MC_Sim_MFTFreq = Simulink.Parameter(500, StorageClass="Const", DataType="double", Min=0, Max=1500)  % 中频任务频率
MC_Sim_MFTStep = Simulink.Parameter(0.00200025, StorageClass="Const", DataType="double", Min=0, Max=1)  % 中频任务步长
MC_Sim_NoisePower_IACbus = Simulink.Parameter(0, StorageClass="Const", DataType="double", Min=0, Max=1)  % 交流母线电流采样噪声
MC_Sim_NoisePower_IDCbus = Simulink.Parameter(0, StorageClass="Const", DataType="double", Min=0, Max=1)  % 直流母线电流采样噪声
MC_Sim_NoisePower_PhaseCurrent = Simulink.Parameter(0, StorageClass="Const", DataType="double", Min=0, Max=1)  % 相电流采样噪声
MC_Sim_NoisePower_PhaseVoltage = Simulink.Parameter(0, StorageClass="Const", DataType="double", Min=0, Max=1)  % 相电压采样噪声
MC_Sim_NoisePower_PositionSensor = Simulink.Parameter(0, StorageClass="Const", DataType="double", Min=0, Max=1)  % 位置传感器采样噪声
MC_Sim_NoisePower_SpeedSensor = Simulink.Parameter(0, StorageClass="Const", DataType="double", Min=0, Max=1)  % 转速传感器采样噪声
MC_Sim_NoisePower_Tempature = Simulink.Parameter(0, StorageClass="Const", DataType="double", Min=0, Max=1)  % 温度采样噪声
MC_Sim_NoisePower_TorqueSensor = Simulink.Parameter(0, StorageClass="Const", DataType="double", Min=0, Max=1)  % 力矩传感器采样噪声
MC_Sim_NoisePower_VACbus = Simulink.Parameter(0, StorageClass="Const", DataType="double", Min=0, Max=1)  % 交流母线电压采样噪声
MC_Sim_NoisePower_VDCbus = Simulink.Parameter(0, StorageClass="Const", DataType="double", Min=0, Max=1)  % 直流母线电压采样噪声
MotorModelType = 1