% Simulink data dictionary MotorControlDataDictionary_Math.sldd

MC_ADC_BitNum = Simulink.Parameter(0, StorageClass="Const", DataType="double", Min=0, Max=24)  % ADC采样位数
MC_ADC_Offset = Simulink.Parameter(0, StorageClass="Const", DataType="double", Min=0, Max=1)  % ADC采样偏执电压
MC_ADC_Ts = Simulink.Parameter(6.0e-7, StorageClass="Const", DataType="single", Min=0, Max=500)  % ADC采样和转换时间
MC_ADC_VRef = Simulink.Parameter(1, StorageClass="Const", DataType="double", Min=0, Max=5)  % ADC采样参考电压
MC_CSA_Gain = Simulink.Parameter(1, StorageClass="Const", DataType="double", Min=0, Max=500)  % CSA放大增益
MC_Input_Ibus = Simulink.Parameter(80, StorageClass="Const", DataType="double", Min=0, Max=500)  % 电机最大电流
MC_Input_Power = Simulink.Parameter(4, StorageClass="Const", DataType="double", Min=0, Max=500)  % 电机最大功率
MC_Input_Vdc = Simulink.Parameter(13.5, StorageClass="Const", DataType="double", Min=0, Max=500)  % 电机额定电压
MC_Input_VdcMax = Simulink.Parameter(16, StorageClass="Const", DataType="double", Min=0, Max=500)  % 电机最大工作电压
MC_Input_VdcMin = Simulink.Parameter(8, StorageClass="Const", DataType="double", Min=0, Max=500)  % 电机最小工作电压
MC_MOS_Cs = Simulink.Parameter(1.0e-6, StorageClass="Const", DataType="double", Min=0, Max=500)  % 逆变器MOS管参数
MC_MOS_DeadTime = Simulink.Parameter(1.3e-6, StorageClass="Const", DataType="single", Min=0, Max=1)  % 逆变器上下桥死区时间
MC_MOS_Rds = Simulink.Parameter(0.001, StorageClass="Const", DataType="double", Min=0, Max=500)  % 逆变器MOS管内阻
MC_MOS_Threshold = Simulink.Parameter(0.5, StorageClass="Const", DataType="double", Min=0, Max=500)  % 逆变器MOS管开启电压
MC_Motor_BEMF = Simulink.Parameter(4.294, StorageClass="Const", DataType="double", Min=0, Max=500)  % 电机反电势系数
MC_Motor_Mechinal_Damp = Simulink.Parameter(1.0e-5, StorageClass="Const", DataType="double", Min=0, Max=500)  % 电机机械阻尼
MC_Motor_Mechinal_Fric = Simulink.Parameter(0, StorageClass="Const", DataType="double", Min=0, Max=500)  % 电机静摩擦
MC_Motor_Mechinal_Inertia = Simulink.Parameter(0.0103, StorageClass="Const", DataType="double", Min=0, Max=500)  % 电机转动惯量
MC_Motor_Mechinal_TF = Simulink.Parameter(0.0859, StorageClass="Const", DataType="double", Min=0, Max=500)  % 电机阻力系数
MC_Motor_ModelType = Simulink.Parameter(1, StorageClass="Const", DataType="single", Min=0, Max=500)  % 电机模型
MC_Motor_Phi = Simulink.Parameter(0.005919025, StorageClass="Const", DataType="double", Min=0, Max=500)  % 电机永磁体磁链
MC_Motor_Rotor_Pn = Simulink.Parameter(4, StorageClass="Const", DataType="double", Min=0, Max=500)  % 电机转子极对数
MC_Motor_SpeedMax = Simulink.Parameter(3000, StorageClass="Const", DataType="double", Min=0, Max=500)  % 电机最大转速
MC_Motor_Stator_L0 = Simulink.Parameter(0, StorageClass="Const", DataType="double", Min=0, Max=500)  % 电机定子零序电感
MC_Motor_Stator_Lalpha = Simulink.Parameter(5.6345e-5, StorageClass="Const", DataType="double", Min=0, Max=500)  % 电机定子零序电感
MC_Motor_Stator_Lalphabeta = Simulink.Parameter(0, StorageClass="Const", DataType="double", Min=0, Max=500)  % 电机定子零序电感
MC_Motor_Stator_Lbeta = Simulink.Parameter(5.6345e-5, StorageClass="Const", DataType="double", Min=0, Max=500)  % 电机定子零序电感
MC_Motor_Stator_Ld = Simulink.Parameter(5.6345e-5, StorageClass="Const", DataType="double", Min=0, Max=500)  % 电机定子D轴电感
MC_Motor_Stator_Lq = Simulink.Parameter(5.6345e-5, StorageClass="Const", DataType="double", Min=0, Max=500)  % 电机定子Q轴电感
MC_Motor_Stator_Rs = Simulink.Parameter(0.0286, StorageClass="Const", DataType="double", Min=0, Max=500)  % 电机定子相电阻
MC_Motor_WindType = Simulink.Parameter(1, StorageClass="Const", DataType="single", Min=0, Max=500)  % 电机定子绕组模型
MC_Param_CurrentPI_Err = Simulink.Parameter(1, StorageClass="Const", DataType="single", Min=0, Max=500)  % 电流环积分分离误差阈值
MC_Param_CurrentPI_Ki = Simulink.Parameter(0.008970579, StorageClass="Const", DataType="single", Min=0, Max=1000000000)  % 电流环Ki
MC_Param_CurrentPI_Kp = Simulink.Parameter(0.2832209, StorageClass="Const", DataType="single", Min=0, Max=1000000000)  % 电流环Kp
MC_Param_CurrentPI_UdInitial = Simulink.Parameter(0, StorageClass="Const", DataType="single", Min=0, Max=13.5)  % 电流环Ud积分初值
MC_Param_CurrentPI_UdInteMax = Simulink.Parameter(7.794229, StorageClass="Const", DataType="single", Min=0, Max=13.5)  % 电流环Ud积分上限
MC_Param_CurrentPI_UdInteMin = Simulink.Parameter(-7.794229, StorageClass="Const", DataType="single", Min=-13.5, Max=13.5)  % 电流环Ud积分下限
MC_Param_CurrentPI_UdMax = Simulink.Parameter(7.794229, StorageClass="Const", DataType="single", Min=0, Max=13.5)  % 电流环Ud输出上限
MC_Param_CurrentPI_UdMin = Simulink.Parameter(-7.794229, StorageClass="Const", DataType="single", Min=-13.5, Max=13.5)  % 电流环Ud输出下限
MC_Param_CurrentPI_UqInitial = Simulink.Parameter(0, StorageClass="Const", DataType="single", Min=0, Max=13.5)  % 电流环Uq积分初值
MC_Param_CurrentPI_UqInteMax = Simulink.Parameter(7.794229, StorageClass="Const", DataType="single", Min=0, Max=13.5)  % 电流环Uq积分上限
MC_Param_CurrentPI_UqInteMin = Simulink.Parameter(-7.794229, StorageClass="Const", DataType="single", Min=-13.5, Max=13.5)  % 电流环Uq积分下限
MC_Param_CurrentPI_UqMax = Simulink.Parameter(7.794229, StorageClass="Const", DataType="single", Min=0, Max=13.5)  % 电流环Uq输出上限
MC_Param_CurrentPI_UqMin = Simulink.Parameter(-7.794229, StorageClass="Const", DataType="single", Min=-13.5, Max=13.5)  % 电流环Uq输出下限
MC_Param_CurrentPI_Wc = Simulink.Parameter(800, StorageClass="Const", DataType="single", Min=0, Max=1000000000)  % 电流环带宽
MC_Param_Flux_Gamma = Simulink.Parameter(750000, StorageClass="Const", DataType="single", Min=0, Max=1.0e+36)  % 磁链观测器增益
MC_Param_Flux_Lalpha = Simulink.Parameter(5.6345e-5, StorageClass="Const", DataType="single", Min=0, Max=1)  % 磁链观测器α轴电感
MC_Param_Flux_Lbeta = Simulink.Parameter(5.6345e-5, StorageClass="Const", DataType="single", Min=0, Max=1)  % 磁链观测器β轴电感
MC_Param_Flux_PLL_Ki = Simulink.Parameter(2.930426, StorageClass="Const", DataType="single", Min=0, Max=1.0e+36)  % 磁链观测器锁相环Ki
MC_Param_Flux_PLL_Kp = Simulink.Parameter(153.2484, StorageClass="Const", DataType="single", Min=0, Max=1.0e+36)  % 磁链观测器锁相环Kp
MC_Param_Flux_PLL_Wc = Simulink.Parameter(50, StorageClass="Const", DataType="single", Min=0, Max=1.0e+36)  % 磁链观测器锁相环带宽
MC_Param_Flux_Ralpha = Simulink.Parameter(0.0286, StorageClass="Const", DataType="single", Min=0, Max=1)  % 磁链观测器α轴电阻
MC_Param_Flux_Rbeta = Simulink.Parameter(0.0286, StorageClass="Const", DataType="single", Min=0, Max=1)  % 磁链观测器β轴电阻
MC_Param_Luen_BEMFErr = Simulink.Parameter(10, StorageClass="Const", DataType="single", Min=-1.0e+36, Max=1.0e+36)  % 龙贝格观测器β轴电流误差参数
MC_Param_Luen_BEMFalpha = Simulink.Parameter(-17747.8, StorageClass="Const", DataType="single", Min=-1.0e+36, Max=1.0e+36)  % 龙贝格观测器α轴反电势参数
MC_Param_Luen_BEMFbeta = Simulink.Parameter(-17747.8, StorageClass="Const", DataType="single", Min=-1.0e+36, Max=1.0e+36)  % 龙贝格观测器β轴反电势参数
MC_Param_Luen_CurrentErr = Simulink.Parameter(400, StorageClass="Const", DataType="single", Min=-1.0e+36, Max=1.0e+36)  % 龙贝格观测器α轴电流误差参数
MC_Param_Luen_Currentalpha = Simulink.Parameter(-507.5872, StorageClass="Const", DataType="single", Min=-1.0e+36, Max=1.0e+36)  % 龙贝格观测器α轴电流参数
MC_Param_Luen_Currentbeta = Simulink.Parameter(-507.5872, StorageClass="Const", DataType="single", Min=-1.0e+36, Max=1.0e+36)  % 龙贝格观测器β轴电流参数
MC_Param_Luen_PLL_Ki = Simulink.Parameter(0.2463453, StorageClass="Const", DataType="single", Min=0, Max=1.0e+36)  % 龙贝格观测器锁相环Ki
MC_Param_Luen_PLL_Kp = Simulink.Parameter(125.6637, StorageClass="Const", DataType="single", Min=0, Max=1.0e+36)  % 龙贝格观测器锁相环Kp
MC_Param_Luen_PLL_Wc = Simulink.Parameter(10, StorageClass="Const", DataType="single", Min=0, Max=1.0e+36)  % 龙贝格观测器锁相环带宽
MC_Param_Luen_Voltagealpha = Simulink.Parameter(17747.8, StorageClass="Const", DataType="single", Min=-1.0e+36, Max=1.0e+36)  % 龙贝格观测器α轴电压参数
MC_Param_Luen_Voltagebeta = Simulink.Parameter(17747.8, StorageClass="Const", DataType="single", Min=-1.0e+36, Max=1.0e+36)  % 龙贝格观测器β轴电压参数
MC_Param_PhasetoReal = Simulink.Parameter(500, StorageClass="Const", DataType="single", Min=0, Max=100000000)  % 转速转换角度
MC_Param_RPMtoRad = Simulink.Parameter(0.1047198, StorageClass="Const", DataType="single", Min=0, Max=500)  % RPM转换Rad
MC_Param_RadtoRPM = Simulink.Parameter(9.549297, StorageClass="Const", DataType="single", Min=0, Max=500)  % Rad转换RPM
MC_Param_SMO_CoffA = Simulink.Parameter(0.9683266, StorageClass="Const", DataType="single", Min=0, Max=500)  % 滑膜电流参数
MC_Param_SMO_CoffB = Simulink.Parameter(1.107463, StorageClass="Const", DataType="single", Min=0, Max=500)  % 滑膜电压参数
MC_Param_SMO_E_Max = Simulink.Parameter(2, StorageClass="Const", DataType="single", Min=0, Max=500)  % 滑膜饱和函数最大值
MC_Param_SMO_E_Min = Simulink.Parameter(-2, StorageClass="Const", DataType="single", Min=-500, Max=0)  % 滑膜饱和函数最小值
MC_Param_SMO_PLL_Ki = Simulink.Parameter(6.158633, StorageClass="Const", DataType="single", Min=0, Max=1.0e+36)  % 滑膜观测器锁相环Ki
MC_Param_SMO_PLL_Kp = Simulink.Parameter(628.3185, StorageClass="Const", DataType="single", Min=0, Max=1.0e+36)  % 滑膜观测器锁相环Kp
MC_Param_SMO_PLL_Wc = Simulink.Parameter(50, StorageClass="Const", DataType="single", Min=0, Max=1.0e+36)  % 滑膜观测器锁相环带宽
MC_Param_SVPWM_DutyMax = Simulink.Parameter(0.98, StorageClass="Const", DataType="single", Min=0, Max=1)  % SVPWM占空比最大值
MC_Param_SVPWM_DutyMin = Simulink.Parameter(0.02, StorageClass="Const", DataType="single", Min=0, Max=1)  % SVPWM占空比最小值
MC_Param_SVPWM_SampleOffset1 = Simulink.Parameter(0.02, StorageClass="Const", DataType="single", Min=0, Max=1)  % SVPWM采样点1偏移
MC_Param_SVPWM_SampleOffset2 = Simulink.Parameter(0.015, StorageClass="Const", DataType="single", Min=0, Max=1)  % SVPWM采样点2偏移
MC_Param_SVPWM_SampleValid = Simulink.Parameter(0.009615385, StorageClass="Const", DataType="single", Min=0, Max=1)  % SVPWM采样最小有效时间
MC_Param_SpeedCtrl_IdMax = Simulink.Parameter(60, StorageClass="Const", DataType="single", Min=-80, Max=80)  % 转速控制器Id最大输出
MC_Param_SpeedCtrl_IdMin = Simulink.Parameter(-60, StorageClass="Const", DataType="single", Min=-80, Max=80)  % 转速环控制器Id最小输出
MC_Param_SpeedCtrl_IqMax = Simulink.Parameter(60, StorageClass="Const", DataType="single", Min=-80, Max=80)  % 转速控制器Iq最大输出
MC_Param_SpeedCtrl_IqMin = Simulink.Parameter(-60, StorageClass="Const", DataType="single", Min=-80, Max=80)  % 转速环控制器Iq最小输出
MC_Param_SpeedPI_Ki = Simulink.Parameter(0.5715709, StorageClass="Const", DataType="single", Min=0, Max=1000000000)  % 转速环Ki
MC_Param_SpeedPI_Ki_II = Simulink.Parameter(0.5715709, StorageClass="Const", DataType="single", Min=0, Max=1000000000)  % 转速环Ki
MC_Param_SpeedPI_Kp = Simulink.Parameter(9.111411, StorageClass="Const", DataType="single", Min=0, Max=1000000000)  % 转速环Kp
MC_Param_SpeedPI_Kp_II = Simulink.Parameter(9.111411, StorageClass="Const", DataType="single", Min=0, Max=1000000000)  % 转速环Kp
MC_Param_SpeedPI_Wc = Simulink.Parameter(5, StorageClass="Const", DataType="single", Min=0, Max=500)  % 转速环带宽
MC_Param_SpeedtoTheta = Simulink.Parameter(6.24e-5, StorageClass="Const", DataType="single", Min=0, Max=500)  % 转速转换角度
MC_Param_Zero = Simulink.Parameter(0, StorageClass="Const", DataType="single", Min=0, Max=0)  % 参数零值
MC_Paran_CurrentADRC_LESO_W0 = Simulink.Parameter(6.283185, StorageClass="Const", DataType="single", Min=0, Max=5026.548)  % 电流ADRC的LESO带宽
MC_Paran_CurrentADRC_NLSEF_Wc = Simulink.Parameter(6.283185, StorageClass="Const", DataType="single", Min=0, Max=5026.548)  % 电流ADRC的NLSEF带宽
MC_Sample_CurrentNoise = Simulink.Parameter(1.0e-15, StorageClass="Const", DataType="double", Min=0, Max=500)  % 相电流采样噪声功率

MC_Sample_Model = Simulink.Parameter(1, StorageClass="Const", DataType="double", Min=0, Max=500)  % 相电流采样策略
  % 1：单电阻；2：双电阻；3：三电阻

MC_Sample_ORSType = Simulink.Parameter(2, StorageClass="Const", DataType="double", Min=0, Max=500)  % 单电阻采样策略
  % 1：单边采样；2：双边采样

MC_Sample_Rs = Simulink.Parameter(0.002, StorageClass="Const", DataType="double", Min=0, Max=500)  % 硬件采样电阻
MC_Sample_ValidTime = Simulink.Parameter(6.0e-7, StorageClass="Const", DataType="single", Min=0, Max=1)  % 电流采样最小有效时间
MC_Sample_VbusNoise = Simulink.Parameter(1.0e-15, StorageClass="Const", DataType="double", Min=0, Max=500)  % 母线电压采样噪声功率
MC_Sim_BaseFreq = Simulink.Parameter(48000000, StorageClass="Const", DataType="double", Min=0, Max=1)  % 基础步长
MC_Sim_BaseStep = Simulink.Parameter(2.08e-8, StorageClass="Const", DataType="double", Min=0, Max=1)  % 基础步长
MC_Sim_HFTFreq = Simulink.Parameter(16000, StorageClass="Const", DataType="double", Min=0, Max=1)  % 高频任务步长
MC_Sim_HFTStep = Simulink.Parameter(6.24e-5, StorageClass="Const", DataType="double", Min=0, Max=1)  % 高频任务步长
MC_Sim_MFTFreq = Simulink.Parameter(500, StorageClass="Const", DataType="double", Min=0, Max=1)  % 中频任务步长
MC_Sim_MFTStep = Simulink.Parameter(0.0019968, StorageClass="Const", DataType="double", Min=0, Max=1)  % 中频任务步长
MotorModelType = 1